# Dynamo graph ExampleFile.dyn (Dynamo 2.12.0.5650)

file_path = Filename("C:\Users\BIA97506\Mott MacDonald\Sydney Computational Design Team - Documents\ExcelReaderAndWriter\test sheets\Haven Lateral calculation.xls")
sheetNames = DynExcel.Reader.SheetNames(filePath=file_path)
file_path_2 = Filename("C:\Users\BIA97506\Mott MacDonald\Sydney Computational Design Team - Documents\ExcelReaderAndWriter\test sheets\20170208 371138 Core Walls.xlsm")
file_path_3 = Filename("C:\Users\BIA97506\Mott MacDonald\Sydney Computational Design Team - Documents\ExcelReaderAndWriter\test sheets\Haven Lateral calculation.csv")
integer_slider = IntegerSlider(0, range=0..10 step 1)
integer_slider_2 = IntegerSlider(5, range=0..10 step 1)
integer_slider_3 = IntegerSlider(8, range=0..10 step 1)
code_block = CodeBlock(x=integer_slider, y=integer_slider_2, z=integer_slider_3) { [x,y]; [[x,y], [x,z]]; }
file_path_4 = Filename("C:\Users\BIA97506\Mott MacDonald\Sydney Computational Design Team - Documents\ExcelReaderAndWriter\test sheets\AS4100 - Steel bending custom sections.xlsx")
code_block_2 = CodeBlock { "T-Section"; ["T-Section","Custom Section"]; 0; [0,1]; }
integer_slider_4 = IntegerSlider(0, range=0..10 step 1)
integer_slider_5 = IntegerSlider(5, range=0..10 step 1)
code_block_3 = CodeBlock(x=integer_slider_4, y=integer_slider_5) { [x,y]; }
sheetData = DynExcel.Reader.SheetData(filePath=file_path_4, sheet=code_block_2.out2, rowRange=code_block_3, columnRange=code_block_3)
python_script = Python()  # CPython3; unwired: IN[0]
# ---------- python_script.python (3 lines) ----------
# Load the Python Standard and DesignScript Libraries
import os
OUT = os.path.join(os.path.join(os.environ['USERPROFILE']), 'Desktop') 
# ----------------------------------------
code_block_4 = CodeBlock { "TestFile"; "SheetName"; ["ID", "Shape", "Area"]; }
code_block_5 = CodeBlock()
# ---------- code_block_5.designscript (3 lines) ----------
[["001", "003", "004"],
["Triangle", "Square", "Circle"],
[10, 50, 60]];
# ----------------------------------------
boolean = BoolSelector(false)
excel = DynExcel.Writer.Excel(path=python_script, fileName=code_block_4.out0, sheetName=code_block_4.out1, headers=code_block_4.out2, data=code_block_5, save=boolean)
