# Grasshopper definition ExampleFile.gh (Grasshopper 1.0.7)
# plug-ins: GhExcel

panel = Panel("""001
005
006
008""")
panel_2 = Panel("""40
10
34.5
0,1""")
panel_3 = Panel("""Type
Area
Id""")
panel_4 = Panel("""Circle
Square
Rectangle
Triangle""")
c_script = CSharpScript()  # -> out, A
# ---------- c_script: C# ----------
    A = Environment.GetFolderPath(Environment.SpecialFolder.Desktop);
# ---------- end c_script ----------
# C:\Users\BIA97506\Mott MacDonald\Sydney Computational Design Team - Documents\02_Tools\003_ExcelReaderAndWriter\test sheets\Haven Lateral calculation.csv
# C:\Users\BIA97506\Mott MacDonald\Sydney Computational Design Team - Documents\ExcelReaderAndWriter\test sheets\Haven Lateral calculation.xls
# C:\Users\BIA97506\Mott MacDonald\Sydney Computational Design Team - Documents\ExcelReaderAndWriter\test sheets\20170208 371138 Core Walls.xlsm
panel_5 = Panel("C:\Users\BIA97506\Mott MacDonald\Sydney Computational Design Team - Documents\02_Tools\003_ExcelReaderAndWriter\test sheets\AS4100 - Steel bending custom sections.xlsx")
panel_6 = Panel("""SheetName1
SheetName2""")
panel_7 = Panel("""Wind Static
Wind Dynamic""")
panel_8 = Panel("""Wind Static
Wind Dynamic""")
panel_9 = Panel(c_script.A)
txt = Text("TestWrite")
txt_2 = Text(panel_3)
txt_3 = Text(panel_6)
txt_4 = Text("Wind Static")
txt_5 = Text(panel_7)
txt_6 = Text("A0:C5")
txt_7 = Text(panel_8)
entwine = Entwine(Branch00=panel_4, Branch01=panel_2, Branch02=panel, FlattenInputs=True)
entwine_2 = Entwine(Branch0X=txt_2, Branch1X=txt_2, FlattenInputs=False)
entwine_3 = Entwine(Branch0X=entwine, Branch1X=entwine, FlattenInputs=False)
excelsheets = ExcelSheets(FilePath=panel_5)
excelreader = ExcelReader(FilePath=panel_5, Sheets=Slider(0, range=0..3), CellRange=txt_6)
panel_10 = Panel(excelsheets)
panel_11 = Panel(excelreader)
excelwriter = ExcelWriter(Write=Button(), Path=panel_9, FileName=txt, Sheet=txt_3, Headers=entwine_2, Data=entwine_3)
