# Dynamo graph ExampleFile.dyn (Dynamo 2.12.0.5650)
# packages: Sandbox 1.0.0.0

file_path = Filename("C:\Users\BIA97506\Mott MacDonald\Sydney Computational Design Team - Documents\ExcelReaderAndWriter\test sheets\20170208 371138 Core Walls.xlsm")
file_path_2 = Filename("..\..\..\..\..\..\Mott MacDonald\Sydney Computational Design Team - Documents\02_Tools\003_ExcelReaderAndWriter\test sheets\Haven Lateral calculation.csv")
sandbox_reader_csv = Sandbox.ExcelTools.Reader.CSV(filePath=file_path_2)
watch = Watch(sandbox_reader_csv)
python_script = Python()  # CPython3; unwired: IN[0]
# ---------- python_script.python (3 lines) ----------
# Load the Python Standard and DesignScript Libraries
import os
OUT = os.path.expanduser("~\\Desktop")
# ----------------------------------------
code_block = CodeBlock { "TestFile"; "SheetName"; "SheetName2"; ["ID", "Shape", "Area"]; }
code_block_2 = CodeBlock()
# ---------- code_block_2.designscript (3 lines) ----------
[["001", "003", "004"],
["Triangle", "Square", "Circle"],
[10, 50, 60]];
# ----------------------------------------
sandbox_writer_datasheet = Sandbox.ExcelTools.Writer.DataSheet(sheetName=code_block.out1, headers=code_block.out3, data=code_block_2)
sandbox_writer_datasheet_2 = Sandbox.ExcelTools.Writer.DataSheet(sheetName=code_block.out2, headers=code_block.out3, data=code_block_2)
join = List.Join(list0=sandbox_writer_datasheet, list1=sandbox_writer_datasheet_2)
boolean = BoolSelector(false)
excel = Sandbox.ExcelTools.Writer.Excel(path=python_script, fileName=code_block.out0, sheets=join, save=boolean)
code_block_3 = CodeBlock()
# ---------- code_block_3.designscript (6 lines) ----------
[Point.ByCoordinates(-5.79803, 10.532202, 0),
Point.ByCoordinates(1.80856, 5.000136, 0),
Point.ByCoordinates(-9.787501, 10.159851, 0),
Point.ByCoordinates(-7.978941, 5.106522, 0),
Point.ByCoordinates(-4.415014, 3.08519, 0),
Point.ByCoordinates(-2.446875, 10.851359, 0)];
# ----------------------------------------
code_block_4 = CodeBlock()
# ---------- code_block_4.designscript (6 lines) ----------
[Point.ByCoordinates(-3.61712, 7.340626, 0),
Point.ByCoordinates(-0.319158, 7.712976, 0),
Point.ByCoordinates(-6.170381, 13.776971, 0),
Point.ByCoordinates(-7.127854, 0.478736, 0),
Point.ByCoordinates(-0.159579, 2.925612, 0),
Point.ByCoordinates(1.223438, 13.564199, 0)];
# ----------------------------------------
byStartPointEndPoint = Line.ByStartPointEndPoint(startPoint=code_block_3, endPoint=code_block_4)
sandbox_lines = Sandbox.GeometryTools.Lines.OrderLinesByProximity(lines=byStartPointEndPoint)
code_block_5 = CodeBlock { 0.5; }
pointAtParameter = Curve.PointAtParameter(curve=sandbox_lines.Lines, param=code_block_5)
code_block_6 = CodeBlock { -1; }
shiftIndices = List.ShiftIndices(list=pointAtParameter, amount=code_block_6)
byTwoPoints = Vector.ByTwoPoints(start=pointAtParameter, end=shiftIndices)
byStartPointDirectionLength = Line.ByStartPointDirectionLength(startPoint=pointAtParameter, direction=byTwoPoints)
code_block_7 = CodeBlock { [0,0.5,1]; }
code_block_8 = CodeBlock(x=sandbox_lines.Lines) { List.Count(x) - 1; }
range = Range(end=code_block_8)
remapRange = Math.RemapRange(numbers=range)
color_range = ColorRange(indices=code_block_7, value=remapRange)  # unwired: colors
byGeometryColor = Modifiers.GeometryColor.ByGeometryColor(geometry=byStartPointDirectionLength, color=color_range)
code_block_9 = CodeBlock()
# ---------- code_block_9.designscript (11 lines) ----------
[Point.ByCoordinates(2.007487, 8.3117, 0),
Point.ByCoordinates(2.007487, 7.180412, 0),
Point.ByCoordinates(2.007487, 6.464235, 0),
Point.ByCoordinates(2.007487, 4.176446, 0),
Point.ByCoordinates(3.367784, 4.176446, 0),
Point.ByCoordinates(4.640987, 4.176446, 0),
Point.ByCoordinates(5.996631, 4.709117, 0),
Point.ByCoordinates(7.200084, 5.716088, 0),
Point.ByCoordinates(7.200084, 6.526576, 0),
Point.ByCoordinates(7.200084, 7.435306, 0),
Point.ByCoordinates(5.308944, 7.435306, 0)];
# ----------------------------------------
sandbox_points_removecollinear = Sandbox.GeometryTools.Points.RemoveCollinear(pts=code_block_9)
file_path_3 = Filename("..\..\..\..\..\..\Mott MacDonald\Sydney Computational Design Team - Documents\02_Tools\003_ExcelReaderAndWriter\test sheets\AS4100 - Steel bending custom sections.xlsx")
code_block_10 = CodeBlock { "T-Section"; ["T-Section","Custom Section"]; 1; [0,1]; "A0:B5"; }
sandbox_reader_excel = Sandbox.ExcelTools.Reader.Excel(filePath=file_path_3, sheet=code_block_10.out2)
file_path_4 = Filename("..\..\..\..\..\..\Mott MacDonald\Sydney Computational Design Team - Documents\02_Tools\003_ExcelReaderAndWriter\test sheets\Haven Lateral calculation.xls")
sandbox_reader_sheetnames = Sandbox.ExcelTools.Reader.SheetNames(filePath=file_path_4)
sandbox_reader_excel_2 = Sandbox.ExcelTools.Reader.Excel(filePath=file_path_3, sheet=code_block_10.out0, cellRange=code_block_10.out4)
