# Grasshopper definition ExampleFile.gh (Grasshopper 1.0.7)
# plug-ins: SandboxGh

# ---- group: Excel tool
# C:\Users\BIA97506\Mott MacDonald\Sydney Computational Design Team - Documents\ExcelReaderAndWriter\test sheets\Haven Lateral calculation.xls
# C:\Users\BIA97506\Mott MacDonald\Sydney Computational Design Team - Documents\ExcelReaderAndWriter\test sheets\20170208 371138 Core Walls.xlsm
panel = Panel("C:\Users\BIA97506\Mott MacDonald\Sydney Computational Design Team - Documents\02_Tools\003_ExcelReaderAndWriter\test sheets\Haven Lateral calculation.csv")
panel_2 = Panel("C:\Users\BIA97506\Mott MacDonald\Sydney Computational Design Team - Documents\02_Tools\003_ExcelReaderAndWriter\test sheets\AS4100 - Steel bending custom sections.xlsx")
panel_3 = Panel("""I-Section
T-Section""")
panel_4 = Panel("""A0:C5
A1:D5""")
txt = Text("T-Section")
txt_2 = Text(panel_3)
txt_3 = Text("A0:C5")
txt_4 = Text(panel_4)
excelsheets = ExcelSheets(FilePath=panel_2)
csvreader = CSVReader(FilePath=panel, CellRange=txt_3)
excelreader = ExcelReader(FilePath=panel_2, Sheets=Slider(0, range=0..3))
excelreader_2 = ExcelReader(FilePath=panel_2, Sheets=txt_2, CellRange=txt_4)
panel_5 = Panel("""001
005
006
008""")
panel_6 = Panel("""40
10
34.5
0,1""")
panel_7 = Panel("""Type
Area
Id""")
panel_8 = Panel("""Circle
Square
Rectangle
Triangle""")
c_script = CSharpScript()  # -> out, A
# ---------- c_script: C# ----------
    A = Environment.GetFolderPath(Environment.SpecialFolder.Desktop);
# ---------- end c_script ----------
panel_9 = Panel(c_script.A)
txt_5 = Text("TestWrite")
txt_6 = Text("SheetName1")
txt_7 = Text(panel_7)
txt_8 = Text("SheetName2")
entwine = Entwine(Branch00=panel_8, Branch01=panel_6, Branch02=panel_5, FlattenInputs=True)
excelsheet = ExcelSheet(Name=txt_6, Headers=txt_7, Data=entwine)
excelsheet_2 = ExcelSheet(Name=txt_8, Headers=txt_7, Data=entwine)
merge = Merge(Data1=excelsheet, Data2=excelsheet_2)
excelwriter = ExcelWriter(Write=Button(), Path=panel_9, FileName=txt_5, Sheet=merge)

# ---- group: Utilities / Dictionary
panel_10 = Panel("""Afghanistan
Albania
Algeria
Argentina

Australia
Austria
Bangladesh
Belgium
Bolivia
Botswana
Brazil
Bulgaria
Cambodia
Cameroon
Canada
Chile
China
Colombia
Costa Rica
Croatia
Cuba
Czech Republic
Denmark
Dominican Republic
Ecuador
Egypt
El Salvador""")
panel_11 = Panel("""Dari (Persian) - Pashto
Albanian
Arabic
Spanish

English
German
Bengali
French / Flemish
Spanish
English, Setswana
Portuguese
Bulgarian
Cambodian
French / English
English / French
Spanish
Chinese
Spanish
Spanish
Croatian
Spanish
Czech
Danish
Spanish
Spanish
Arabic
Spanish""")
value_list = ValueList({"Afghanistan": "Dari (Persian) - Pashto", "Albania": "Albanian", "Algeria": "Arabic", "Argentina": "Spanish", "", "Australia": "English", "Austria": "German", "Bangladesh": "Bengali", "Belgium": "French / Flemish", "Bolivia": "Spanish", "Botswana": "English, Setswana", "Brazil": "Portuguese", "Bulgaria": "Bulgarian", "Cambodia": "Cambodian", "Cameroon": "French / English", "Canada": "English / French", "Chile": "Spanish", "China": "Chinese", "Colombia": "Spanish", "Costa Rica": "Spanish", "Croatia": "Croatian", "Cuba": "Spanish", "Czech Republic": "Czech", "Denmark": "Danish", "Dominican Republic": "Spanish", "Ecuador": "Spanish", "Egypt": "Arabic", "El Salvador": "Spanish"}, selected="Belgium")
create_dictionary = CreateDictionary(Key=panel_10, Value=panel_11)
series = Series(Start=0, Step=1, Count="5")
charseq = CharSequence(Count="5", CharPool="ABCDEFGHIJKLMNOPQRSTUVWXYZ", Format="{0}")
panel_12 = Panel("C:\Users\BIA97506\Mott MacDonald\Sydney Computational Design Team - Documents\Example Folder")
panel_13 = Panel(value_list)
fd = FilterDictionary(Dict=create_dictionary, Pattern="Al*")
panel_14 = Panel(create_dictionary)
panel_15 = Panel("""{0,0,0}
{0,10,0}""")
panel_16 = Panel("""Algeria
Argentina""")
create_dictionary_2 = CreateDictionary(Key=charseq, Value=series)
dict = Dictionary(fd)
deletekeydictionary = DeleteKeyDictionary(Dict=create_dictionary, Keys="Australia")
mergedict = MergeDictionary(Dictionary1=flatten(dict), Dictionary2=flatten(create_dictionary_2))
panel_17 = Panel(dict)
editvaluedictionary = EditValueDictionary(Dict=create_dictionary, Key=panel_16, Value=panel_15)
readdict = ReadDictionary(Dict=editvaluedictionary)  # -> Key, Value
readdict_2 = ReadDictionary(Dict=deletekeydictionary)  # -> Key, Value
readdict_3 = ReadDictionary(Dict=mergedict)  # -> Key, Value
jsonfromdictionary = JSONFromDictionary(Dict=create_dictionary)
csvfromdictionary = CSVFromDictionary(Dict=create_dictionary, Path=panel_12, FileName="csvExport")
panel_18 = Panel(jsonfromdictionary)
panel_19 = Panel(readdict_3.Key)
panel_20 = Panel(readdict_3.Value)
panel_21 = Panel(readdict.Value)
panel_22 = Panel(readdict_2.Key)

# ----
valuetypedictionary = ValueTypeDictionary(Dict=mergedict)
panel_23 = Panel(valuetypedictionary)

# ---- group: Geometry / Points
pt = Point([Point(2.007486925, 8.31170025, 0), Point(2.007486925, 7.180411746, 0), Point(2.007486925, 6.464234565, 0), Point(2.007486925, 4.176446348, 0), Point(3.367783548, 4.176446348, 0), Point(4.640987425, 4.176446348, 0), Point(5.996631429, 4.709117213, 0), Point(7.200084168, 5.716087872, 0), Point(7.200084168, 6.526576452, 0), Point(7.200084168, 7.435306071, 0), Point(5.30894415, 7.435306071, 0)])
panel_24 = Panel("0.1")
removecollinearpoints = RemoveCollinearPoints(Points=pt)

# ---- group: Geometry / Lines
crv = Curve([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])
line = Line(crv)
lng = ListLength(List=line)
curvepoint = PointOnCurve(line, parameter=0.5)
series_2 = Series(Start=0, Step=1, Count=expr("x-1", lng))
orderlinesbyproximity = OrderLinesByProximity(Lines=line)  # -> OrderedLines, OrderedIndexes, Revers
item = ListItem(List=curvepoint, Index=orderlinesbyproximity.OrderedIndexes, Wrap=True)
order = PointOrder(Points=item)
tag = TextTag(Location=curvepoint, Text=series_2)
