# Dynamo graph ExampleFile.dyn (Dynamo 2.12.0.5650)
# packages: MMLib 1.0.0

file_path = Filename("C:\Users\BIA97506\Mott MacDonald\Sydney Computational Design Team - Documents\ExcelReaderAndWriter\test sheets\20170208 371138 Core Walls.xlsm")
file_path_2 = Filename("C:\Users\BIA97506\Mott MacDonald\Sydney Computational Design Team - Documents\ExcelReaderAndWriter\test sheets\Haven Lateral calculation.csv")
file_path_3 = Filename("C:\Users\BIA97506\Mott MacDonald\Sydney Computational Design Team - Documents\ExcelReaderAndWriter\test sheets\Haven Lateral calculation.xls")
file_path_4 = Filename("..\..\..\..\..\..\Mott MacDonald\Sydney Computational Design Team - Documents\02_Tools\003_ExcelReaderAndWriter\test sheets\AS4100 - Steel bending custom sections.xlsx")
sheetNames = DynTools.ExcelTool.Reader.SheetNames(filePath=file_path_4)
code_block = CodeBlock { "T-Section"; ["T-Section","Custom Section"]; 1; [0,1]; "A0:B5"; }
sheetData = DynTools.ExcelTool.Reader.SheetData(filePath=file_path_4, sheet=code_block.out2, cellRange=code_block.out4)
python_script = Python()  # CPython3; unwired: IN[0]
# ---------- python_script.python (3 lines) ----------
# Load the Python Standard and DesignScript Libraries
import os
OUT = os.path.join(os.path.join(os.environ['USERPROFILE']), 'Desktop') 
# ----------------------------------------
code_block_2 = CodeBlock()
# ---------- code_block_2.designscript (5 lines) ----------
"TestFile";
"SheetName";
["ID", "Shape", "Area"];
["SheetName1", "SheetName2"];
[["ID", "Shape", "Area"],["ID", "Shape", "Area"]];
# ----------------------------------------
byKeysValues = DesignScript.Builtin.Dictionary.ByKeysValues(keys=code_block_2.out3, values=code_block_2.out4)
code_block_3 = CodeBlock()
# ---------- code_block_3.designscript (6 lines) ----------
[[["001", "003", "004"],
["Triangle", "Square", "Circle"],
[10, 50, 60]],
[["001", "003", "004"],
["Triangle", "Square", "Circle"],
[10, 50, 60]]];
# ----------------------------------------
byKeysValues_2 = DesignScript.Builtin.Dictionary.ByKeysValues(keys=code_block_2.out3, values=code_block_3)
boolean = BoolSelector(false)
excel = DynTools.ExcelTool.Writer.Excel(path=python_script, fileName=code_block_2.out0, sheetNames=code_block_2.out2, headers=byKeysValues, data=byKeysValues_2, save=boolean)
