# Grasshopper definition ExampleFile.gh (Grasshopper 1.0.7)
# plug-ins: GhExcel

panel = Panel("""001
005
006
008""")
panel_2 = Panel("""40
10
34.5
0,1""")
panel_3 = Panel("""Type
Area
Id""")
panel_4 = Panel("""Circle
Square
Rectangle
Triangle""")
panel_5 = Panel("C:\Users\BIA97506\Mott MacDonald\Sydney Computational Design Team - Documents\ExcelReaderAndWriter\test sheets\Haven Lateral calculation.csv")
# C:\Users\BIA97506\Mott MacDonald\Sydney Computational Design Team - Documents\ExcelReaderAndWriter\test sheets\Haven Lateral calculation.xls
# C:\Users\BIA97506\Mott MacDonald\Sydney Computational Design Team - Documents\ExcelReaderAndWriter\test sheets\20170208 371138 Core Walls.xlsm
panel_6 = Panel("C:\Users\BIA97506\Mott MacDonald\Sydney Computational Design Team - Documents\ExcelReaderAndWriter\test sheets\AS4100 - Steel bending custom sections.xlsx")
c_script = CSharpScript()  # -> out, A
# ---------- c_script: C# ----------
    A = Environment.GetFolderPath(Environment.SpecialFolder.Desktop);
# ---------- end c_script ----------
panel_7 = Panel("""Wind Static
Wind Dynamic""")
panel_8 = Panel(c_script.A)
txt = Text("TestWrite")
txt_2 = Text("SheetName")
txt_3 = Text(panel_3)
dom = ConstructDomain(DomainStart=Slider(0, range=0..5), DomainEnd=Slider(9, range=0..10))
dom_2 = ConstructDomain(DomainStart=Slider(0, range=0..5), DomainEnd=Slider(10, range=0..10))
dom_3 = ConstructDomain(DomainStart=Slider(0, range=0..5), DomainEnd=Slider(7, range=0..10))
txt_4 = Text("Wind Static")
txt_5 = Text(panel_7)
entwine = Entwine(Branch00=panel_4, Branch01=panel_2, Branch02=panel, FlattenInputs=True)
merge = Merge(Data1=dom_2, Data2=dom_3)
excelsheets = ExcelSheets(FilePath=panel_6)
ghexcelreader = GhExcelReader(FilePath=panel_5, Sheets=Slider(0, range=0..3), RowRangeSelection=dom, ColumnRangeSelection=merge)
excelwriter = ExcelWriter(Write=Button(), Path=panel_8, FileName=txt, Sheet=txt_2, Headers=txt_3, Data=entwine)
panel_9 = Panel(excelsheets)
panel_10 = Panel(ghexcelreader)
