# Dynamo graph ExampleFile.dyn (Dynamo 2.12.0.5650)
# packages: MMLib 1.0.0

file_path = Filename("C:\Users\BIA97506\Mott MacDonald\Sydney Computational Design Team - Documents\ExcelReaderAndWriter\test sheets\20170208 371138 Core Walls.xlsm")
file_path_2 = Filename("..\..\..\..\..\..\Mott MacDonald\Sydney Computational Design Team - Documents\02_Tools\003_ExcelReaderAndWriter\test sheets\Haven Lateral calculation.csv")
CSV = MMLib.ExcelTool.Reader.CSV(filePath=file_path_2)
watch = Watch(CSV)
file_path_3 = Filename("..\..\..\..\..\..\Mott MacDonald\Sydney Computational Design Team - Documents\02_Tools\003_ExcelReaderAndWriter\test sheets\AS4100 - Steel bending custom sections.xlsx")
code_block = CodeBlock { "T-Section"; ["T-Section","Custom Section"]; 1; [0,1]; "A0:B5"; }
excel = MMLib.ExcelTool.Reader.Excel(filePath=file_path_3, sheet=code_block.out2)
excel_2 = MMLib.ExcelTool.Reader.Excel(filePath=file_path_3, sheet=code_block.out0, cellRange=code_block.out4)
file_path_4 = Filename("..\..\..\..\..\..\Mott MacDonald\Sydney Computational Design Team - Documents\02_Tools\003_ExcelReaderAndWriter\test sheets\Haven Lateral calculation.xls")
sheetNames = MMLib.ExcelTool.Reader.SheetNames(filePath=file_path_4)
python_script = Python()  # CPython3; unwired: IN[0]
# ---------- python_script.python (3 lines) ----------
# Load the Python Standard and DesignScript Libraries
import os
OUT = os.path.expanduser("~\\Desktop")
# ----------------------------------------
code_block_2 = CodeBlock { "TestFile"; "SheetName"; "SheetName2"; ["ID", "Shape", "Area"]; }
code_block_3 = CodeBlock()
# ---------- code_block_3.designscript (3 lines) ----------
[["001", "003", "004"],
["Triangle", "Square", "Circle"],
[10, 50, 60]];
# ----------------------------------------
dataSheet = MMLib.ExcelTool.Writer.DataSheet(sheetName=code_block_2.out1, headers=code_block_2.out3, data=code_block_3)
dataSheet_2 = MMLib.ExcelTool.Writer.DataSheet(sheetName=code_block_2.out2, headers=code_block_2.out3, data=code_block_3)
join = List.Join(list0=dataSheet, list1=dataSheet_2)
boolean = BoolSelector(false)
excel_3 = MMLib.ExcelTool.Writer.Excel(path=python_script, fileName=code_block_2.out0, sheets=join, save=boolean)
