# Grasshopper definition ExampleFile.gh (Grasshopper 1.0.7)
# plug-ins: MMLib

panel = Panel("""001
005
006
008""")
panel_2 = Panel("""40
10
34.5
0,1""")
panel_3 = Panel("""Type
Area
Id""")
panel_4 = Panel("""Circle
Square
Rectangle
Triangle""")
c_script = CSharpScript()  # -> out, A
# ---------- c_script: C# ----------
    A = Environment.GetFolderPath(Environment.SpecialFolder.Desktop);
# ---------- end c_script ----------
panel_5 = Panel("C:\Users\BIA97506\Mott MacDonald\Sydney Computational Design Team - Documents\02_Tools\003_ExcelReaderAndWriter\test sheets\Haven Lateral calculation.csv")
# C:\Users\BIA97506\Mott MacDonald\Sydney Computational Design Team - Documents\ExcelReaderAndWriter\test sheets\Haven Lateral calculation.xls
# C:\Users\BIA97506\Mott MacDonald\Sydney Computational Design Team - Documents\ExcelReaderAndWriter\test sheets\20170208 371138 Core Walls.xlsm
panel_6 = Panel("C:\Users\BIA97506\Mott MacDonald\Sydney Computational Design Team - Documents\02_Tools\003_ExcelReaderAndWriter\test sheets\AS4100 - Steel bending custom sections.xlsx")
panel_7 = Panel("""I-Section
T-Section""")
panel_8 = Panel(c_script.A)
txt = Text("TestWrite")
txt_2 = Text("SheetName1")
txt_3 = Text(panel_3)
txt_4 = Text("SheetName2")
txt_5 = Text("T-Section")
txt_6 = Text(panel_7)
txt_7 = Text("A0:C5")
entwine = Entwine(Branch00=panel_4, Branch01=panel_2, Branch02=panel, FlattenInputs=True)
excelsheet = ExcelSheet(Name=txt_2, Headers=txt_3, Data=entwine)
excelsheet_2 = ExcelSheet(Name=txt_4, Headers=txt_3, Data=entwine)
excelreader = ExcelReader(FilePath=panel_6, Sheets=txt_5, CellRange=txt_7)
excelreader_2 = ExcelReader(FilePath=panel_6, Sheets=Slider(0, range=0..3), CellRange=txt_7)
csvreader = CSVReader(FilePath=panel_5, CellRange=txt_7)
excelsheets = ExcelSheets(FilePath=panel_6)
merge = Merge(Data1=excelsheet, Data2=excelsheet_2)
panel_9 = Panel(excelsheets)
panel_10 = Panel(excelreader_2)
excelwriter = ExcelWriter(Write=Button(), Path=panel_8, FileName=txt, Sheet=merge)
